# Grasshopper definition outgrow-gh_00.ghx (Grasshopper 1.0.7)

# ----
# Option 1 : Writing in ghpy component
polygon = Polygon(Plane=PlaneXY(0, 0, 0), Radius=3, Segments=6, FilletRadius=0)  # -> Polygon, Length
python = GhPythonScript(polygon=polygon.Polygon)  # -> out, a; inputs polygon: Polyline
# ---------- python: Python ----------
def polygon_area(vertices):
    n = len(vertices)
    area = 0.0
    for i in range(n):
        j = (i + 1) % n
        area += vertices[i][0] * vertices[j][1] - vertices[j][0] * vertices[i][1]
    return abs(area / 2)

a = polygon_area(polygon)
# ---------- end python ----------

# ----
# Option 2 : Writing externally and reading inside ghpython component
# Option 3 : Importing as a Python Module
path = FilePath("C:\Users\kchadha\Documents\GitHub\outgrow-gh\compas_kittens\src\compas_kittens\Area.py")
file = ReadFile(File=path, PerLineParse=False)
python_2 = GhPythonScript(Code=file, Polygon=polygon.Polygon)  # -> Out, A

# ----
# Option 4 : Loading python modules using compas
button = Button()
# Option 5 : Importing as a Python Library
polygon_2 = Polygon(Plane=PlaneXY(0, 0, 0), Radius=3, Segments=6, FilletRadius=0)  # -> Polygon, Length

python_3 = GhPythonScript(polygon=polygon.Polygon)  # -> out, a; inputs polygon: Polyline
# ---------- python_3: Python ----------
from Area import polygon_area

a = polygon_area(polygon)
# ---------- end python_3 ----------
python_4 = GhPythonScript(polygon=polygon_2.Polygon)  # -> out, a; inputs polygon: Polyline
# ---------- python_4: Python ----------
from compas_kittens.Area import polygon_area


a = polygon_area(polygon)
# ---------- end python_4 ----------
python_5 = GhPythonScript(reload=button)  # -> out, a
# ---------- python_5: Python ----------
import sys
import os

from compas_rhino import unload_modules

ghcanvas = ghenv.Component.OnPingDocument()
folder = os.path.dirname(ghcanvas.FilePath)

if folder not in sys.path:
    sys.path.append(folder)

if reload:
    mods= unload_modules("Area")
    print ("Unloaded {} modules".format(len(mods)))
# ---------- end python_5 ----------

panel = Panel(python.a)
panel_2 = Panel(python_2.A)
panel_3 = Panel(python_3.a)
panel_4 = Panel([python_5.a, python_5.out])
